# Grasshopper definition building.gh (Grasshopper 1.0.7)

groundfloor_height = Slider(3, range=3..10)
height = Slider(13, range=3..100)
tile_width = Slider(3, range=3..10)
floor_height = Slider(3.4, range=3..10)
lot = Curve(<curve referenced from the Rhino model>)

crv = Curve(lot)
num = Number(groundfloor_height)
num_2 = Number(floor_height)
num_3 = Number(height)
num_4 = Number(tile_width)
integer_division = IntegerDivision(A=num_3, B=num_2)
Z = UnitZ(Factor=num)
expression = Expression(x=num_2, y=integer_division, z=num, Expression="(x*y)+z")
series = Series(Start=num_2, Step=num_2, Count=expr("x-1", integer_division))
move = Move(Geometry=crv, Motion=Z)  # -> Geometry, Transform
explode = Explode(Curve=crv, Recursive=True)  # -> Segments, Vertices
extr = Extrude(Base=crv, Direction=Z)
Z_2 = UnitZ(Factor=num_2)
len = Length(Curve=explode.Segments)
extr_2 = Extrude(Base=move.Geometry, Direction=Z_2)
Z_3 = UnitZ(Factor=series)
integer_division_2 = IntegerDivision(A=len, B=num_4)
end = EndPoints(Curve=explode.Segments)  # -> Start, End
move_2 = Move(Geometry=extr_2, Motion=Z_3)  # -> Geometry, Transform
vec2pt = Vector2Pt(PointA=end.Start, PointB=end.End, Unitize=False)  # -> Vector, Length
multiplication = Multiplication(A=integer_division_2, B=num_4)
line = LineSDL(Start=end.Start, Direction=vec2pt.Vector, Length=multiplication)
divide = DivideCurve(Curve=line, Count=integer_division_2, Kinks=False)  # -> Points, Tangents, Parameters
midpt = CurveMiddle(Curve=line)
midpt_2 = CurveMiddle(Curve=explode.Segments)
shatter = Shatter(Curve=graft(line), Parameters=divide.Parameters)
vec2pt_2 = Vector2Pt(PointA=midpt, PointB=midpt_2, Unitize=False)  # -> Vector, Length
move_3 = Move(Geometry=shatter, Motion=graft(vec2pt_2.Vector))  # -> flatten(Geometry), Transform
join = JoinCurves(Curves=move_3.Geometry, Preserve=False)
cp = ControlPoints(Curve=join)  # -> Points, Weights, Knots
line_2 = LineSDL(Start=cp.Points, Direction=Vector(0, 0, 1), Length=expression)  # -> flatten(Line)
data = Data(flatten([extr, extr_2, move_2.Geometry]))
